# Grasshopper definition Components bookWorm.gh (Grasshopper 1.0.7)
# plug-ins: Bookworm

toggle = BooleanToggle(True)
number_slider = Slider(2, range=0..10)
connumberformat = ConstructNumberFormat(NumberFormatType="1")
conpadding = ConstructPadding(Top="1")
concellborder = ConstructCellBorder(Style="5", Color=ColourSwatch(SwatchColor=RGB(0, 42, 255)))
swatch = ColourSwatch(SwatchColor=RGB(242, 205, 94))
contextformat = ConstructTextFormat(
    ForegroundColor=ColourSwatch(SwatchColor=RGB(196, 0, 255)),
    FontFamily="Arial",
    FontSize=Slider(14, range=0..100),
    Bold=toggle,
    Italic=toggle,
    Strikethrought=toggle,
    Underline=toggle,
    Link="http://parametrica.team")
contextrotation = ConstructTextRotation(Angle=Slider(41, range=0..100), Vertical=Toggle(True))
concellborders = ConstructCellBorders(BorderTop=concellborder)
number_slider_2 = Slider(500, range=0..1000)
panel = Panel("""Количество комнат
Евро
Студия""")
conextendedvalue = ConstructExtendedValue(Value=panel)
concellformat = ConstructCellFormat(
    NumberFormat=connumberformat,
    Color=swatch,
    Borders=concellborders,
    Padding=conpadding,
    HorizontalAligment=number_slider,
    VerticalAligment=number_slider,
    Wrap=number_slider,
    TextDirection=Toggle(True),
    TextFormat=contextformat)
concellformat_2 = ConstructCellFormat(NumberFormat=connumberformat, Color=swatch, Borders=concellborders)
concell = ConstructCell()
concell_2 = ConstructCell(UserEnteredValue=conextendedvalue, CellFormat=concellformat_2)
panel_2 = Panel(concellformat_2)
readcell = ReadCell(
    SpreadsheetId="136sKKVnzYGOcDbLzDCTKq6zVEHlm_2nUyYPIjH6f-F4",
    SheetName="Квартирография_1",
    CellRange="A1:B2",
    Read=Toggle(True),
    SameLength=False)
decell = DeconstructCell(Cell=readcell)  # -> FormattedValue, UserEnteredValue, CellFormat
concell_3 = ConstructCell(UserEnteredValue=decell.UserEnteredValue, CellFormat=decell.CellFormat)  # -> flatten(Cell)
panel_3 = Panel("A1:B2")
cull_i = CullIndex(List=concell_3, Indices="3", Wrap=True)
item = ListItem(List=cull_i, Index=0, Wrap=True)
merge = Merge(Data1=cull_i, Data2=item)  # -> flatten(Result)
panel_4 = Panel(merge)
nickname = UpdateCells(
    SpreadsheetId="1A4-OZONXYfRZbBfHRNpN6nU8IgeaBQi29x4bGgja-Aw",
    SheetName="ns gbkjh",
    Cells=concell_2,
    Range="E25:F26",
    Fields="*",
    Run=Toggle(True))
